# Grasshopper definition A03-building-grid-slabs_hs25.gh (Grasshopper 1.0.8)

# ----
# Geometry Pipeline
geometry_pipeline = GeometryPipeline(
    GroupByLayer=False,
    GroupByType=False,
    IncludeHidden=True,
    IncludeLocked=True,
    LayerFilter="Geometric_Filter",
    NameFilter="*",
    SublayerFiltering=True,
    TypeFilter=1073741848)
sunion = SolidUnion(Breps=geometry_pipeline)

# ----
# Applying classes to create buildings
# Main Task
mainbeam_class = Python3Script()  # -> MainBeam
# ---------- mainbeam_class: Python ----------
# r: compas
# venv: ca-hs25

class MainBeam:
    def __init__(self, geometry, edge):
        self.geometry = geometry
        self.edge = edge
# ---------- end mainbeam_class ----------
slab_class = Python3Script()  # -> Slab
# ---------- slab_class: Python ----------
# r: compas
# venv: ca-hs25

# Main task: create the class Slab
class ....:
    # ... your code here ...
# ---------- end slab_class ----------
column_class = Python3Script()  # -> Column
# ---------- column_class: Python ----------
# r: compas
# venv: ca-hs25

class Column:
    def __init__(self, geometry, edge):
        self.geometry = geometry
        self.edge = edge
# ---------- end column_class ----------
buildinggrid_class = Python3Script(MainBeam=mainbeam_class, Column=column_class, Slab=slab_class)  # -> BuildingGrid
# ---------- buildinggrid_class: Python ----------
# r: compas
# venv: ca-hs25

"""
## Main task

Goal: Create slabs for our building grid.

A slab is represented visually as a box (using compas.geometry.Box).
The basic idea is to rely on volmesh to know where to add each slab.
We will create one slab per each face of our grid's volmesh if the face is 
aligned to the XY plane (ie. flat).

We will create a Slab class that will contain the attributes and methods of each slab.
The Slab class needs 3 attributes: `geometry` (a box), `category` (a string), and
the `halfface` id (an integer) from which we created the slab.
The attribute `category` will only be used if you tackle challenge 01.
Otherwise you can ignore it.

#### Details

The algorithm that we need to implement, as well as hints to functions you might need,
is in code comments, as a step-by-step guide.

"""

from compas.geometry import Box
from compas.geometry import Frame
from compas.geometry import Line
from compas.geometry import Point
from compas.geometry import Vector
from compas.datastructures import VolMesh


# The building grid class contains both data (attributes)
# of our grid and also its behavior (methods)
class BuildingGrid:
    def __init__(self, xsize, ysize, zsize, nx, ny, nz, selected_filter):
        self.volmesh = self.create_volmesh(selected_filter, xsize, ysize, zsize, nx, ny, nz)
        self.columns = []
        self.main_beams = []
        self.slabs = []

    # START OF MAIN TASK
    # Create a generate_slabs method that takes a slab_height as parameter
    # and appends slabs to the self.slabs attribute of the grid instance
    # Unlike in previous exercises, the slabs will not just be boxes, but we
    # will create instances of a class Slab that we define in the component
    # before this one. Creating the definition of the Slab class is also part
    # of the main task. You have as examples the main beam and column
    # components that are doing the same
    def generate_slabs(self, slab_height):
        # 1. Reset slabs list to an empty list
        # ... your code here ...

        # 2. Iterate: for each face in the volmesh (hint: faces() of volmesh)
        # ... your code here ...

            # 3. Get the normal of the half-face (hint: face_normal() of volmesh)
            # ... your code here ...

            # 4. Calculate dot product of the face normal to the Z axis vector
            #    if it's parallel to the unit Z axis, we will add a slab
            # ... your code here ...
                
                # 5. To add a slab, first find the centroid of the half-face (hint: halfface_centroid() of volmesh)
                # ... your code here ...
                
                # 6. Find the points of the face (hint: face_points() of volmesh)
                # ... your code here ...

                # 7. Create a box using two corner points + the slab_height parameter 
                #    (hint: use Box.from_corner_corner_height)
                # ... your code here ...
                
                # 8. Create an instance of the slab class you created above
                # ... your code here ...

                # 9. Append it to the grid.slabs attribute list
                # ... your code here ...
                
    # END OF MAIN TASK
                

    # Generate columns and append them to the self.columns attribute
    def generate_columns(self, column_width_x, column_depth_y):
        self.column_width_x = column_width_x
        self.column_depth_y = column_depth_y
        
        # First reset the list of columns
        self.columns = []

        # Now generate columns
        for uv in self.volmesh.edges():
            # If the edge vector is parallel to unit vector Z...
            edge_vector = self.volmesh.edge_direction(uv)

            if edge_vector.dot(Vector.Zaxis()) in (1, -1):
                # ...we add a column
                edge_midpoint = self.volmesh.edge_point(uv)
                edge_length = self.volmesh.edge_length(uv)

                box = Box(column_width_x, column_depth_y, edge_length)
                box.frame.point = edge_midpoint
                
                column = Column(box, uv)
                self.columns.append(column)
                
    def number_of_columns(self):
        return len(self.columns)
    
    def number_of_main_beams(self):
        return len(self.main_beams)

    def calculate_volume(self):
        pass

    # This method is provided as is
    # It shows how to create main beams
    # Main beams are a nbit more complicated than columns
    # because they need to be adjusted in length to match the column
    def generate_main_beams(self, main_beam_width, main_beam_height):
        # First reset the list of main beams
        self.main_beams = []
        self.main_beam_width = main_beam_width
        self.main_beam_height = main_beam_height

        for uv in self.volmesh.edges():
            edge_vector = self.volmesh.edge_direction(uv)

            if edge_vector.dot(Vector.Zaxis()) == 0:

                start, end = self.volmesh.edge_coordinates(uv)
                line = Line(start, end)
                
                # Shorten the beam to fit the columns
                if edge_vector.dot(Vector.Xaxis()) in (1, -1):
                    shift_value = self.column_width_x
                else:
                    shift_value = self.column_depth_y
 
                # Create the box in the origin of world XY frame
                box = Box.from_width_height_depth(main_beam_width, main_beam_height, line.length - shift_value)
                frame = Frame(line.midpoint, edge_vector.cross(Vector.Zaxis()), edge_vector)
                frame.point.z -= main_beam_height / 2
        
                # Move box to correct frame
                box.frame = frame
                
                mainbeam = MainBeam(box, uv)
                self.main_beams.append(mainbeam)

    def create_volmesh(self, selected_filter, xsize, ysize, zsize, nx, ny, nz):
        volmesh = VolMesh()
        vertex_keys = dict()

        for ix in range(nx):
            for iy in range(ny):
                for iz in range(nz):
                    corner_1 = Point(ix * xsize, iy * ysize, iz * zsize)
                    corner_2 = Point(corner_1.x + xsize, corner_1.y + ysize, corner_1.z)
                    
                    # Only add cell if within filter
                    if selected_filter.is_included(corner_1, ix, iy, iz):
                        box = Box.from_corner_corner_height(corner_1, corner_2, zsize)
                        corner_points = box.compute_vertices()
                        vertices = []

                        for v in corner_points:
                            gkey = str(v)
                            if gkey not in vertex_keys:
                                vertex_keys[gkey] = volmesh.add_vertex(x=v[0], y=v[1], z=v[2])

                            vertex = vertex_keys[gkey]
                            vertices.append(vertex)

                        a, b, c, d, e, f, g, h = vertices
                        faces = [
                            [a,d,c,b],  # bottom face
                            [a,e,f,d],  # front face
                            [a,b,h,e],  # left face
                            [b,c,g,h],  # back face
                            [d,f,g,c],  # right face
                            [e,h,g,f],  # top face
                        ]

                        # Add the cell with the defined faces
                        volmesh.add_cell(faces, attr_dict=dict(ix=ix, iy=iy, iz=iz))
        
        return volmesh
# ---------- end buildinggrid_class ----------

# ---- group: Options
main_beam_width = Slider(0.35, range=0.1..0.9)
main_beam_height = Slider(0.4, range=0.1..0.9)
column_width_x = Slider(0.35, range=0.1..0.9)
column_depth_y = Slider(0.45, range=0.1..0.9)
slab_height = Slider(0.55, range=0.1..0.9)

# ---- group: Grid size
# Challenge 01: ## Challenge 01
# 
# Goal: Assign the category of each slab
# 
# Each slab can be assigned one of three different categories: "roof", "floor_slab" or "bottom_slab".
# 
# Depending on each category we want to visualize the slabs with a different color.
# 
# #### Details
# 
# The algorithm that we need to implement, as well as hints to functions you might need,
# is in code comments, as a step-by-step guide.
number_slider = Slider(9, range=0..20)
number_slider_2 = Slider(9, range=0..20)
number_slider_3 = Slider(9, range=0..20)

# ---- group: Cell sizes
number_slider_4 = Slider(7, range=0..20)
number_slider_5 = Slider(4.5, range=0..20)
number_slider_6 = Slider(3.5, range=0..20)

# ---- group: 2. Set file name
# Challenge 02: ## Challenge 02
# 
# Goal: Visualize all the slabs in our building grid in a stacked or "palletized" version.
# 
# The idea is to take all the slabs that are created in the building, and
# make a copy of and visualize them in stacks of slabs, as if they were in
# pallets for transportation.
# 
# #### Details
# 
# The algorithm that we need to implement, as well as hints to functions
# you might need, is in code comments, as a step-by-step guide.
mustermann_max = Panel("mustermann_max")
assignment_nr = Panel("A03_")

# ---- group: 4. Set display options
toggle = BooleanToggle(True)
toggle_2 = BooleanToggle(True)

# ---- group: 5. Click button to save image
button = Button()

# ---- group: 3. Set image dimensions
height = Panel("2400")
width = Panel("3200")

# ---- group: 1. Select target directory
path = FilePath()

# ----
python = Python3Script(
    path=path,
    name=mustermann_max,
    assignment_nr=assignment_nr,
    width=width,
    height=height,
    display_grid=toggle,
    display_grid_axes=toggle_2,
    save=button)  # -> out; inputs path: String, name: String, assignment_nr: String, width: Int32, height: Int32
# ---------- python: Python ----------
# r: compas
# venv: ca-hs25

import Rhino.Display as rd
import scriptcontext as sc
import System
import os

file_name = name + "_" + assignment_nr

def get_next_index(path):
    index = 1
    while os.path.exists(path + file_name + str(index) + ".png"):
        index += 1
    return index

def ViewCaptureToFile(path):
    view = sc.doc.Views.ActiveView
    if view:
        view_capture = rd.ViewCapture()
        view_capture.TransparentBackground = False
        view_capture.Width = view.ActiveViewport.Size.Width
        view_capture.Height = view.ActiveViewport.Size.Width
        view_capture.ScaleScreenItems = False
        view_capture.DrawAxes = True
        view_capture.DrawGrid = display_grid
        view_capture.DrawGridAxes = display_grid_axes
        size = System.Drawing.Size(view_capture.Width, view_capture.Height)
        size = System.Drawing.Size(width, height)
        
        settings = rd.ViewCaptureSettings(view, size, 72) # view, size, dpi
        settings.RasterMode = True
        settings.DrawGrid = display_grid
        settings.DrawAxis = display_grid_axes
        settings.DrawWallpaper = False
        index = get_next_index(path)
            
        filename = file_name + str(index)
        filename_with_extension = filename + ".png"
        bitmap = rd.ViewCapture.CaptureToBitmap.__overloads__[rd.ViewCaptureSettings](settings)
        fullpath = path + filename_with_extension
        bitmap.Save(fullpath)
        
        return filename_with_extension
        
        
if path is None:
    ghenv.Component.Message = "Please select a target directory first"
else:
    if save:
        path = ViewCaptureToFile(path)
        ghenv.Component.Message = "Saved image to " + path
# ---------- end python ----------

# ----
# Main Task: ## Main task
# 
# Goal: Create slabs for our building grid.
# 
# A slab is represented visually as a box (using compas.geometry.Box).
# The basic idea is to rely on volmesh to know where to add each slab.
# We will create one slab per each face of our grid's volmesh if the face is
# aligned to the XY plane (ie. flat).
# 
# We will create a Slab class that will contain the attributes and methods of each slab.
# The Slab class needs 3 attributes: `geometry` (a box), `category` (a string), and
# the `halfface` id (an integer) from which we created the slab.
# The attribute `category` will only be used if you tackle challenge 01.
# Otherwise you can ignore it.
# 
# #### Details
# 
# The algorithm that we need to implement, as well as hints to functions you might need,
# is in code comments, as a step-by-step guide.
# Filter Classes
# Filter Selection
# Brep Filter: Use your Brep filter from A02 here!
# Brep Filter: Use your merge filter from A02 here!
modulo_filter = Python3Script()  # -> mfilter
# ---------- modulo_filter: Python ----------
# r: compas
# venv: ca-hs25

# Sample filter
class ModuleBasedFilter(object):
    def is_included(self, point, ix, iy, iz):
        if (ix + iy) % 2 == 0:
            return True

        return False

mfilter = ModuleBasedFilter()
# ---------- end modulo_filter ----------
random_filter = Python3Script()  # -> rfilter
# ---------- random_filter: Python ----------
# r: compas
# venv: ca-hs25

# Sample filter
from random import choice

class RandomFilter(object):
    def is_included(self, point, ix, iy, iz):
        return choice([True, False])

rfilter = RandomFilter()
# ---------- end random_filter ----------
linear_filter = Python3Script()  # -> lfilter
# ---------- linear_filter: Python ----------
# r: compas
# venv: ca-hs25

# Sample filter
class LinearFilter(object):
    def __init__(self, coefficient=1, vertical_shift_x=0, vertical_shift_y=0, horizontal_shift_x=0, horizontal_shift_y=0):
        super(LinearFilter, self).__init__()
        self.coefficient = coefficient
        self.vertical_shift_x = vertical_shift_x
        self.vertical_shift_y = vertical_shift_y
        self.horizontal_shift_x = horizontal_shift_x
        self.horizontal_shift_y = horizontal_shift_y

    def is_included(self, point, ix, iy, iz):
        z_range_x = (self.coefficient * ix + self.vertical_shift_x) + self.horizontal_shift_x
        z_range_y = (self.coefficient * iy + self.vertical_shift_y) + self.horizontal_shift_y
        return not z_range_x < iz > z_range_y

lfilter = LinearFilter(coefficient= 1.7, vertical_shift_x= -3, vertical_shift_y=-3, horizontal_shift_x=0, horizontal_shift_y=0)
# ---------- end linear_filter ----------
bfilter = Python3Script(brep=sunion)  # -> bfilter; inputs brep: Brep
# ---------- bfilter: Python ----------
# r: compas
# venv: ca-hs25

"""
Use your implementation of the Brep Filter from A02 here!
"""

# Copy and Paste your solution from A02 here
# [ADD YOUR CODE HERE...]
# ---------- end bfilter ----------
parab_filter = Python3Script()  # -> pfilter
# ---------- parab_filter: Python ----------
# r: compas
# venv: ca-hs25

# Sample filter
class ParaboloidFilter(object):
    def __init__(self, coefficient, horizontal_shift_x, horizontal_shift_y, vertical_shift_x, vertical_shift_y):
        super(ParaboloidFilter, self).__init__()
        self.coefficient = coefficient
        self.vertical_shift_x = vertical_shift_x
        self.vertical_shift_y = vertical_shift_y
        self.horizontal_shift_x = horizontal_shift_x
        self.horizontal_shift_y = horizontal_shift_y


    # Paraboloid filter function
    def is_included(self, point, ix, iy, iz):
        z_paraboloid_x = (self.coefficient * ((ix + self.vertical_shift_x) ** 2 + (iy + self.vertical_shift_y) ** 2)) + self.horizontal_shift_x
        z_paraboloid_y = (self.coefficient * ((iy + self.vertical_shift_x) ** 2 + (ix + self.vertical_shift_x) ** 2)) + self.horizontal_shift_y
    
        # Check if the z value of the point is less than or equal to the z value of the paraboloid
        return z_paraboloid_x > iz < z_paraboloid_y

pfilter = ParaboloidFilter(coefficient=0.2, vertical_shift_x= -4, vertical_shift_y=4, horizontal_shift_x=0, horizontal_shift_y=1)
# ---------- end parab_filter ----------
value_list = ValueList({"Modulo filter": 0, "Random filter": 1, "Linear filter": 2, "Paraboloid filter": 3, "Brep filter": 4, "Merge filter": 5}, selected="Paraboloid filter")

list = ValueList({"Union": "union", "Intersection": "intersection"}, selected="Intersection")
filter = Python3Script(filter1=parab_filter, filter2=bfilter, mode=list)  # -> mfilter
# ---------- filter: Python ----------
# r: compas
# venv: ca-hs25

"""
Use your implementation of the Merge Filter from A02 here!
"""

# Copy and Paste your solution from A02 here
# [ADD YOUR CODE HERE...]
# ---------- end filter ----------

stream_filter = StreamFilter(
    Gate=value_list,
    Stream0=modulo_filter,
    Stream1=random_filter,
    Stream2=linear_filter,
    Stream3=parab_filter,
    Stream5=filter)

# ----
# Create instance of building grid
filter_2 = Data(stream_filter)
buildinggrid = Data(buildinggrid_class)
create_building = Python3Script(
    nx=number_slider,
    ny=number_slider_2,
    nz=number_slider_3,
    xsize=number_slider_4,
    ysize=number_slider_5,
    zsize=number_slider_6,
    selected_filter=filter_2,
    main_beam_width=main_beam_width,
    main_beam_height=main_beam_height,
    column_width_x=column_width_x,
    column_depth_y=column_depth_y,
    slab_height=slab_height,
    BuildingGrid=buildinggrid)  # -> grid; inputs nx: Int32, ny: Int32, nz: Int32
# ---------- create_building: Python ----------
# r: compas
# venv: ca-hs25


# Create an instance of our building grid
grid = BuildingGrid(xsize, ysize, zsize, nx, ny, nz, selected_filter)

grid.generate_columns(column_width_x, column_depth_y)
grid.generate_main_beams(main_beam_width, main_beam_height)
grid.generate_slabs(slab_height)
# ---------- end create_building ----------

# ----
# Challenge 01
python_2 = Python3Script(grid=create_building)  # -> grid
# ---------- python_2: Python ----------
# r: compas
# venv: ca-hs25

"""
## Challenge 01

Goal: Assign the category of each slab

Each slab can be assigned one of three different categories: 
"roof", "floor_slab" or "bottom_slab". 

Depending on each category we want to visualize the slabs with a different color.

#### Details

The algorithm that we need to implement, as well as hints to functions you might need,
is in code comments, as a step-by-step guide.
"""
from compas.geometry import Vector

# 1. Iterate over the existing slabs in the grid.slabs list
# ... your code here ...

    # 2. Find out which half face corresponds to the slab
    # ... your code here ...
    
    # 3. Detect if there's a cell opposite to the half-face we're in (hint: halfface_opposite_cell() of volmesh)
    # ... your code here ...
    
    # 4. Get the normal of the half-face (hint: face_normal() of volmesh)
    # ... your code here ...

    # 5. Calculate dot product of the face normal to the Z axis vector
    # ... your code here ...
    
    # 6. Assign the slab category attribute based on the following logic:
    # If there's an opposite cell, it's a "floor_slab" category
    # ... your code here ...

    # if not, and the dot_product_z_axis is positive, it's a "bottom_slab"
    # ... your code here ...

    # if not, and the dot_product_z_axis is negative, it's a "roof"
    # ... your code here ...
# ---------- end python_2 ----------

# ---- group: Cells
# Visualization
number_slider_7 = Slider(111, range=0..1161)
grid = Data(python_2)
cells = Python3Script(i=number_slider_7, grid=grid)  # -> cells
# ---------- cells: Python ----------
# r: compas
# venv: ca-hs25

from compas_rhino.conversions import mesh_to_rhino

cells = []
for x in grid.volmesh.cells():
    if x < i:
        cells.append(mesh_to_rhino(grid.volmesh.cell_to_mesh(x)))
# ---------- end cells ----------
custom_preview = CustomPreview(Geometry=cells, Material=ColourSwatch(SwatchColor=RGBA(41, 115, 111, 124)))

# ---- group: Columns
columns = Python3Script(grid=python_2)  # -> columns
# ---------- columns: Python ----------
# r: compas
# venv: ca-hs25

# We use this direct conversion instead of the component
# because we want the Box BREP instead of the meshes
from compas_rhino.conversions import box_to_rhino

columns = []

for column in grid.columns:
    column = box_to_rhino(column.geometry)
    columns.append(column)
# ---------- end columns ----------
custom_preview_2 = CustomPreview(Geometry=columns, Material=ColourSwatch(SwatchColor=RGBA(115, 41, 41, 124)))

# ---- group: Main beams
main_beams = Python3Script(grid=python_2)  # -> mainbeams
# ---------- main_beams: Python ----------
# r: compas
# venv: ca-hs25

# We use this direct conversion instead of the component
# because we want the Box BREP instead of the meshes
from compas_rhino.conversions import box_to_rhino

mainbeams = []

for mainbeam in grid.main_beams:
    b = box_to_rhino(mainbeam.geometry)
    mainbeams.append(b)
# ---------- end main_beams ----------
custom_preview_3 = CustomPreview(Geometry=main_beams, Material=ColourSwatch(SwatchColor=RGBA(252, 129, 35, 156)))

# ----
merge = Merge(
    Data1=ColourSwatch(SwatchColor=RGBA(178, 145, 255, 135)),
    Data2=ColourSwatch(SwatchColor=RGBA(235, 208, 188, 173)),
    Data3=ColourSwatch(SwatchColor=RGBA(92, 167, 247, 131)))
slabs = Python3Script(grid=python_2, available_colors=merge)  # -> slabs, colors; inputs available_colors: list
# ---------- slabs: Python ----------
# r: compas
# venv: ca-hs25

# We use this direct conversion instead of the component
# because we want the Box BREP instead of the meshes
from compas_rhino.conversions import box_to_rhino

slabs = []
colors = []

for slab in grid.slabs:
    box = box_to_rhino(slab.geometry)
    
    if slab.category == "roof":
        colors.append(available_colors[0])
    elif slab.category == "bottom_slab":
        colors.append(available_colors[1])
    else:
        colors.append(available_colors[2])
        
    slabs.append(box)
# ---------- end slabs ----------
custom_preview_4 = CustomPreview(Geometry=slabs.slabs, Material=slabs.colors)

# ----
# Challenge 02
pt = Point(Point(83.81634951, 0, 0))
slabs_2 = Python3Script(
    grid=python_2,
    stack_point=pt,
    max_height=Slider(10, range=1..75),
    row_limit=Slider(7, range=1..75),
    x_offset=Slider(8.736, range=0..10),
    y_offset=Slider(8.508, range=0..10),
    z_offset=Slider(0.7, range=0..10))  # -> stacked_slabs; inputs stack_point: Point3d, max_height: Int32
# ---------- slabs_2: Python ----------
# r: compas
# venv: ca-hs25

"""
## Challenge 02

Goal: Visualize all the slabs in our building grid in a stacked or "palletized" version.

The idea is to take all the slabs that are created in the building, and 
make a copy of and visualize them in stacks of slabs, as if they were in
pallets for transportation.

#### Details

The algorithm that we need to implement, as well as hints to functions
you might need, is in code comments, as a step-by-step guide.

"""
from compas.geometry import Point
from compas_rhino.conversions import box_to_rhino, point_to_compas

# 1. Create an empty list to store the stacked slabs
# ... your code here ...

# 2. Iterate over all slabs
#    Hint: since you will need both the slab instance and the index of
#          it to calculate position, use the enumerate() method of python
#          if you don't want to keep a separate counter variable
# ... your code here ...
 
    # 3. For each slab, we need to find out in which row and column
    #    of pallets to place it. This can be achieved is different ways.
    #    Here's one option:
    #      - row is the integer of dividing the index over the multiplication of max height times row limit
    #      - col is the result of integer division of index over max height, modulo the row limit
    #      - height is index modulo max height
    # ... your code here ...

    
    # 4. Calculate x, y, z coordinates based on the starting stack_point 
    #    and the results calculated above
    # ... your code here ...
    
    # 5. Copy the slab's geometry! We don't want to modify the one in the building
    # ... your code here ...
    
    # 6. Create a new point with x, y, z
    # and set it as the origin point of the frame of the copied slab's geometry
    # ... your code here ...
    
    # 7. Convert to a rhino box and append to list
    # ... your code here ...
# ---------- end slabs_2 ----------
custom_preview_5 = CustomPreview(Geometry=slabs_2, Material=ColourSwatch(SwatchColor=RGBA(145, 134, 15, 135)))
