# Grasshopper definition 01_arithmetic_operations_hs25.gh (Grasshopper 1.0.8)

# ----
# Addition
# Input from panel, type hint: int
# type hint: int
panel = Panel("5")
python_3_script = Python3Script(x=panel, y="10")  # -> out, result; inputs x: Int32, y: Int32
# ---------- python_3_script: Python ----------
result = x + y
# ---------- end python_3_script ----------
panel_2 = Panel(python_3_script.result)

# ----
# Input from panel, no type hint -> produces error
# without type hint
panel_3 = Panel("5")
python_3_script_2 = Python3Script(x=panel_3, y="10")  # -> out, result; same code as python_3_script
panel_4 = Panel(python_3_script_2.result)

# ----
# Arithmetic Operations
# Grasshopper
# Addition
# Addition
panel_5 = Panel("5")
# GHPython
panel_6 = Panel("10")
addition = Addition(A=panel_5, B=panel_6)
panel_7 = Panel(addition)

# ----
# Evaluate
panel_8 = Panel("5")
eval = Evaluate(F="x+y", x=panel_8, y="10")
panel_9 = Panel(eval)

# ----
# Input from panel, type: int defined in code
# without type hint
# type defined in code
panel_10 = Panel("5")
python_3_script_3 = Python3Script(x=panel_10, y="10")  # -> out, result
# ---------- python_3_script_3: Python ----------
result = int(x) + int(y)
# ---------- end python_3_script_3 ----------
panel_11 = Panel(python_3_script_3.result)

# ----
# Input from number slider
# without type hint
# but with number slider
number_slider = Slider(5, range=0..10)
python_3_script_4 = Python3Script(x=number_slider, y=Slider(10, range=0..10))  # -> out, result; same code as python_3_script
panel_12 = Panel(python_3_script_4.result)

# ----
# Expression
panel_13 = Panel("5")
expression = Expression(x=panel_13, y="10", Expression="x+y")
panel_14 = Panel(expression)

# ----
# Mass Addition
panel_15 = Panel("""5
3
24
6
8
9""")
ma = MassAddition(Input=panel_15)  # -> Result, PartialResults
panel_16 = Panel(ma.Result)

mod = Modulus(A=Slider(9, range=0..10), B="3")

# ----
# type hint: int
number_slider_2 = Slider(9, range=0..10)
python_3_script_5 = Python3Script(x=number_slider_2, y="3")  # -> out, result; inputs x: Int32, y: Int32
# ---------- python_3_script_5: Python ----------
result = x % y
# ---------- end python_3_script_5 ----------

# ----
# Modulo
panel_17 = Panel(mod)

# ----
# Modulo
panel_18 = Panel(python_3_script_5.result)

# ----
# Square Root
panel_19 = Panel("5")
sqrt = SquareRoot(Value=panel_19)
panel_20 = Panel(sqrt)

# ----
# Pi  (import math library)
python_3_script_6 = Python3Script()  # -> out, result; inputs x: Int32
# ---------- python_3_script_6: Python ----------
import math

result = math.pi
print(result)
# ---------- end python_3_script_6 ----------
panel_21 = Panel(python_3_script_6.result)

# ----
# Pi
panel_22 = Panel("1")
pi = Pi(Factor=panel_22)
panel_23 = Panel(pi)

panel_24 = Panel(python_3_script_6.out)

series = Series(Start=0, Step=1, Count=10)
python_3_script_7 = Python3Script(x=series)  # -> out, y
# ---------- python_3_script_7: Python ----------
y = x ** 2
# ---------- end python_3_script_7 ----------
pt = ConstructPoint(XCoordinate=series, YCoordinate=python_3_script_7.y, ZCoordinate=0)

dom = ConstructDomain(DomainStart="-10", DomainEnd="10")
range = Range(Domain=dom, Steps=Slider(10, range=0..10))
python_3_script_8 = Python3Script(x=range)  # -> out, y; inputs x: Int32; same code as python_3_script_7
pt_2 = ConstructPoint(XCoordinate=range, YCoordinate=python_3_script_8.y, ZCoordinate=0)

# ----
# Polynomials Square
series_2 = Series(Start=0, Step=1, Count=10)
power = Power(A=series_2, B="2")
pt_3 = ConstructPoint(XCoordinate=series_2, YCoordinate=power, ZCoordinate=0)
panel_25 = Panel(pt_3)

# ----
# Polynomials Square
panel_26 = Panel(pt)

# ----
# Polynomials Square
panel_27 = Panel(pt_2)

# ----
# Mass Addition, built-in function
# type hint: int
# List Access
panel_28 = Panel("""5
3
24
6
8
9""")

python_3_script_9 = Python3Script(values=panel_28)  # -> out, result; inputs values: list of Int32
# ---------- python_3_script_9: Python ----------
result = sum(values)
# ---------- end python_3_script_9 ----------

panel_29 = Panel(python_3_script_9.result)

# ----
# Mass Addition, using a `for` loop
# type hint: int
# List Access
panel_30 = Panel("""5
3
24
6
8
9""")

python_3_script_10 = Python3Script(values=panel_30)  # -> out, result; inputs values: list of Int32
# ---------- python_3_script_10: Python ----------
result = 0

for value in values:
    result += value
# ---------- end python_3_script_10 ----------

panel_31 = Panel(python_3_script_10.result)

# ----
# Square Root (import math library)
# type hint: int
panel_32 = Panel("5")

python_3_script_11 = Python3Script(x=panel_32)  # -> out, result; inputs x: Int32
# ---------- python_3_script_11: Python ----------
import math

result = math.sqrt(x)
# ---------- end python_3_script_11 ----------

panel_33 = Panel(python_3_script_11.result)
