# Grasshopper definition 02_operators_hs25.gh (Grasshopper 1.0.8)

# ----
# Grasshopper
# Comparison operators
# Comparison component
number_slider = Slider(10, range=0..20)
# GHPython
number_slider_2 = Slider(11, range=0..20)
larger_than = LargerThan(FirstNumber=number_slider, SecondNumber=number_slider_2)  # -> LargerThan, OrEqualTo
panel = Panel(larger_than.LargerThan)

# ----
# Comparison operators
# Comparison expression in a conditional statement
number_slider_3 = Slider(10, range=0..20)
script = Script(x=number_slider_3, y=Slider(11, range=0..20))  # -> out, result; inputs x: Int32, y: Int32
# ---------- script: Python ----------
result = x > y
# ---------- end script ----------
panel_2 = Panel(script.result)

# ----
# Expression component
number_slider_4 = Slider(10, range=0..20)
expression = Expression(x=number_slider_4, y=Slider(11, range=0..20), Expression="x > y")
panel_3 = Panel(expression)

# ----
# More comparison operators
number_slider_5 = Slider(10, range=0..20)
script_2 = Script(x=number_slider_5, y=Slider(11, range=0..20))  # -> out; inputs x: Int32, y: Int32
# ---------- script_2: Python ----------
print(x < y)   # Will check if x is smaller than y.
print(x <= y)  # Will check if x is smaller or equal than/to y.
print(x == y)  # Will check if x is equals or y.
print(x > y)   # Will check if x is larger than y.
print(x >= y ) # Will check if x is larger or equal than y.
print(x != y)  # Will check if x is NOT equals or y.
# ---------- end script_2 ----------
panel_4 = Panel(script_2)

# ----
# Grasshopper
# Logical operators
# AND operator
number_slider_6 = Slider(2, range=0..20)
# GHPython
number_slider_7 = Slider(2, range=0..20)
gate_and = GateAnd(A=number_slider_6, B=number_slider_7)
panel_5 = Panel(gate_and)

# ----
# Logical operators
# AND operator
number_slider_8 = Slider(0, range=0..20)
script_3 = Script(x=number_slider_8, y=Slider(0, range=0..20))  # -> out, result; inputs x: Boolean, y: Boolean
# ---------- script_3: Python ----------
result = x and y
# ---------- end script_3 ----------
panel_6 = Panel(script_3.result)

# ----
# OR operator
number_slider_9 = Slider(0, range=0..20)
gate_or = GateOr(A=number_slider_9, B=Slider(0, range=0..20))
panel_7 = Panel(gate_or)

# ----
# OR operator
number_slider_10 = Slider(0, range=0..20)
script_4 = Script(x=number_slider_10, y=Slider(0, range=0..20))  # -> out, result; inputs x: Boolean, y: Boolean
# ---------- script_4: Python ----------
result = x or y
# ---------- end script_4 ----------
panel_8 = Panel(script_4.result)

# ----
# NOT operator
number_slider_11 = Slider(0, range=0..20)
script_5 = Script(x=number_slider_11, y=Slider(0, range=0..20))  # -> out, result; inputs x: Boolean, y: Boolean
# ---------- script_5: Python ----------
result = not(x and y)
# ---------- end script_5 ----------
panel_9 = Panel(script_5.result)

# ----
# NOT operator
number_slider_12 = Slider(0, range=0..20)
gate_and_2 = GateAnd(A=number_slider_12, B=Slider(0, range=0..20))

gate_not = GateNot(A=gate_and_2)

panel_10 = Panel(gate_not)
