# Grasshopper definition 03_strings_hs25.gh (Grasshopper 1.0.8)

# ----
# Data Types - Strings - “The Zen of Python”
# Load text
python_3_script = Python3Script()  # -> text
# ---------- python_3_script: Python ----------
text = """The Zen of Python, by Tim Peters

Beautiful is better than ugly.
Explicit is better than implicit.
Simple is better than complex.
Complex is better than complicated.
Flat is better than nested.
Sparse is better than dense.
Readability counts.
Special cases aren't special enough to break the rules.
Although practicality beats purity.
Errors should never pass silently.
Unless explicitly silenced.
In the face of ambiguity, refuse the temptation to guess.
There should be one-- and preferably only one --obvious way to do it.
Although that way may not be obvious at first unless you're Dutch.
Now is better than never.
Although never is often better than *right* now.
If the implementation is hard to explain, it's a bad idea.
If the implementation is easy to explain, it may be a good idea.
Namespaces are one honking great idea -- let's do more of those!"""
# ---------- end python_3_script ----------

# ----
# str(), len(), split(), splitlines(), print
script = Script(text=python_3_script)  # -> text, length, lines, words
# ---------- script: Python ----------
length_text = len(text)
length = str(length_text)  + " characters"

words = text.split()
lines = text.splitlines()

print(words)
# ---------- end script ----------

# ----
# 1
# list access
# tree index
# O”
# “H
# E
# L
# L
# 0
# 0
# 0
# O
# “W
# R
# L
# D”
# 0
panel = Panel("""HELLO
WORLD""")
graft = GraftTree(Tree=panel, IncludeEmptyLists=True, IncludeNullItems=True)
panel_2 = Panel(graft)
script_2 = Script(text=panel_2)  # -> index; inputs text: list
# ---------- script_2: Python ----------
print(text[0])
index = text[0]
# ---------- end script_2 ----------
index_0 = Panel(script_2)

# ----
# indexing, access type
# item access
# O”
# “H
# E
# L
# L
# 0
# list index
# 0
# 3
# 1
# 2
# 4
# O
# “W
# R
# L
# D”
# 1
# 0
# 3
# 1
# 2
panel_3 = Panel("""HELLO
WORLD""")
script_3 = Script(text=panel_3)  # -> index
# ---------- script_3: Python ----------
index = text[0]
print(index)
# ---------- end script_3 ----------
index_0_2 = Panel(script_3)

# ----
# 4
# list access
# O”
# “H
# E
# L
# L
# list index
# 0
# 0
# 1
# O
# “W
# R
# L
# D”
panel_4 = Panel("""HELLO
WORLD""")
script_4 = Script(text=panel_4)  # -> index; inputs text: list; same code as script_2
index_0_3 = Panel(script_4)

# ----
# panel, display
the_zen_of_python = Panel(script.text)
number_of_characters = Panel(script.length)
lines = Panel(script.lines)
words = Panel(script.words)

# ----
# upper(), lower(), index access []
# List Access
words_2 = Text(words)
index = Slider(0, range=0..136)
python_3_script_2 = Python3Script(words=words_2, index=index)  # -> word, word_lower, word_upper; inputs words: list, index: Int32
# ---------- python_3_script_2: Python ----------
word = words[index]
word_lower = word.lower()
word_upper = word.upper()
# ---------- end python_3_script_2 ----------
panel_5 = Panel(python_3_script_2.word)
panel_6 = Panel(python_3_script_2.word_lower)
panel_7 = Panel(python_3_script_2.word_upper)

lines_2 = Text(lines)
script_5 = Script(lines=lines_2)  # -> length; inputs lines: list
# ---------- script_5: Python ----------
length = len(lines)
# ---------- end script_5 ----------

# ----
# list slicing
lines_3 = Text(lines)

# ---- group: Select lines from 3 to 5 (excluded)
script_6 = Script(lines=lines_3)  # -> result; inputs lines: list
# ---------- script_6: Python ----------
result = lines[3:5]
# ---------- end script_6 ----------
panel_8 = Panel(script_6)

# ---- group: Select every second line
script_7 = Script(lines=lines_3)  # -> result; inputs lines: list
# ---------- script_7: Python ----------
result = lines[::2]
# ---------- end script_7 ----------
panel_9 = Panel(script_7)

# ---- group: Select last line
script_8 = Script(lines=lines_3)  # -> result; inputs lines: list
# ---------- script_8: Python ----------
result = lines[-1]
# ---------- end script_8 ----------
panel_10 = Panel(script_8)

# ----
# len()
number_of_words = Panel(script_5)
