# Grasshopper definition 01-room-class-vscode.gh (Grasshopper 1.0.8)

# ---- group: This is needed only ONCE in the GH definition
enable_auto_reload = Python3Script()  # -> ok
# ---------- enable_auto_reload: Python ----------
"""
------------------------------
Using VS Code as Python editor
------------------------------

The simplest way to start using VS Code as our editor, is
to place our Python code in files located IN THE SAME FOLDER as our Grasshopper file.

After we have done that, we need 2 steps: 

1. Enable the COMPAS reloader on one component. This tells Grasshopper to watch for changes in the Pythoh files and reload if changed.
2. Every other component that uses Python code from external files needs to start with a method to ensure Grasshopper knows where to load the files from.

"""
# r: compas
# venv: ca-hs25

from compas_rhino.devtools import DevTools
DevTools.enable_reloader()
ok = "ok"
# ---------- end enable_auto_reload ----------

# ----
data = Data(enable_auto_reload)

# ---- group: Create instances of Room class -> objects
ghpython_script = Python3Script(ok=data)  # -> room
# ---------- ghpython_script: Python ----------
# r: compas
# venv: ca-hs25
from compas_rhino.devtools import DevTools
DevTools.ensure_path()

from mycode import Room

room = Room("Bedroom", 90, [255, 255, 170])
# ---------- end ghpython_script ----------
ghpython_script_2 = Python3Script(ok=data)  # -> room
# ---------- ghpython_script_2: Python ----------
# r: compas
# venv: ca-hs25
from compas_rhino.devtools import DevTools
DevTools.ensure_path()

from mycode import Room

room = Room("Kids room", 80, [255, 255, 170])
# ---------- end ghpython_script_2 ----------
ghpython_script_3 = Python3Script(ok=data)  # -> room
# ---------- ghpython_script_3: Python ----------
# r: compas
# venv: ca-hs25
from compas_rhino.devtools import DevTools
DevTools.ensure_path()

from mycode import Room

room = Room("Living room", 100, [255, 255, 170])
# ---------- end ghpython_script_3 ----------
ghpython_script_4 = Python3Script(ok=data)  # -> room
# ---------- ghpython_script_4: Python ----------
# r: compas
# venv: ca-hs25
from compas_rhino.devtools import DevTools
DevTools.ensure_path()

from mycode import Room

room = Room("Storage room", 90, [255, 255, 170])
# ---------- end ghpython_script_4 ----------
ghpython_script_5 = Python3Script(ok=data)  # -> room
# ---------- ghpython_script_5: Python ----------
# r: compas
# venv: ca-hs25
from compas_rhino.devtools import DevTools
DevTools.ensure_path()

from mycode import Room

room = Room("Guest room", 90, [255, 255, 170])
# ---------- end ghpython_script_5 ----------

# ----
merge = Merge(
    Data1=ghpython_script,
    Data2=ghpython_script_2,
    Data3=ghpython_script_3,
    Data4=ghpython_script_4,
    Data5=ghpython_script_5)

# ---- group: Arrange room instances into a simple 2d grid
arrange = Python3Script(rooms=merge, xsize=Slider(3, range=1..5), ysize=Slider(2, range=1..5))  # -> out, labels, boxes; inputs rooms: list, xsize: Int32, ysize: Int32
# ---------- arrange: Python ----------
# r: compas
# venv: ca-hs25

boxes = []
labels = []
room_index = 0

for x in range(xsize):
    for y in range(ysize):
        if room_index < len(rooms):
            room = rooms[room_index]
            box = room.draw(x, y)

            boxes.append(box)
            labels.append(room.name)

            room_index += 1
# ---------- end arrange ----------

# ----
draw = Python3Script(cg=arrange.boxes)  # -> rg
#   port cg: The COMPAS geometry or datastructure to be drawn.
#   port rg: The Rhino geometry object.
# ---------- draw: Python ----------
# r: compas
# venv: ca-hs25

"""
Draws COMPAS geometry in Grasshopper.
"""

from ghpythonlib.componentbase import executingcomponent as component

from compas.scene import SceneObject


class CompasToRhinoGeometry(component):
    def RunScript(self, cg):
        if not cg:
            return None

        return SceneObject(item=cg).draw()
# ---------- end draw ----------

# ---- group: Add extra data
box_properties = BoxProperties(Box=draw)  # -> Center, Diagonal, Area, Volume, Degeneracy
text_tag = TextTag(Location=box_properties.Center, Text=arrange.labels, Colour=ColourSwatch(SwatchColor=RGB(255, 255, 255)))
