# Grasshopper definition 01-geometry-and-datastructures_hs25.gh (Grasshopper 1.0.8)

# ---- group: GhPython Script
# geometry types & datastructures
primitives = Python3Script()  # -> point, polyline, polygon
# ---------- primitives: Python ----------
# r: compas
# venv: ca-hs25

from compas.geometry import Frame
from compas.geometry import Plane
from compas.geometry import Point
from compas.geometry import Polygon
from compas.geometry import Polyline
from compas.geometry import Vector

# Point, Vector & Plane
point = Point(0, 0, 0)
vector = Vector(0, 0, 1)
plane = Plane(point, vector)
print(point)
print(vector)
print(plane)

# Frame
xaxis = [1, 0, 0]
yaxis = [0, 1, 0]
frame = Frame(point, xaxis, yaxis)
print(frame)

# Polyline
p1 = [0, 0, 0]
p2 = [1, 0, 0]
p3 = [1, 1, 0]
p4 = [0, 0, 0]
polyline = Polyline([p1, p2, p3, p4])
print(polyline)

# Polygon
polygon = Polygon([p1, p2, p3])
print(polygon)
# ---------- end primitives ----------

operations = Python3Script()  # -> point, u, v
# ---------- operations: Python ----------
# r: compas
# venv: ca-hs25

from compas.geometry import Point
from compas.geometry import Vector

# Point
point = Point(1, 2, 3)
print("Power of 3 of the point", point**3)
print("Add two points", point + [0, 2, 1])

# Vector
u = Vector(1, 0, 0)
v = Vector(0, 1, 0)
print("Add two vectors", u + v)
print("Dot product of vector", u.dot(v))
print("Cross product", u.cross(v))
print("Unitize vector", (u * 2).unitized())
# ---------- end operations ----------
draw = Python3Script(cg=operations.point)  # -> rg
#   port cg: The COMPAS geometry or datastructure to be drawn.
#   port rg: The Rhino geometry object.
# ---------- draw: Python ----------
# r: compas
# venv: ca-hs25

"""
Draws COMPAS geometry in Grasshopper.
"""

from ghpythonlib.componentbase import executingcomponent as component

from compas.scene import SceneObject


class CompasToRhinoGeometry(component):
    def RunScript(self, cg):
        if not cg:
            return None

        return SceneObject(item=cg).draw()
# ---------- end draw ----------
draw_2 = Python3Script(cg=operations.u)  # -> rg; same code as draw
draw_3 = Python3Script(cg=operations.v)  # -> rg; same code as draw

construct = Python3Script()  # -> v1, v2, f1, f2
# ---------- construct: Python ----------
# r: compas
# venv: ca-hs25

from compas.geometry import Frame
from compas.geometry import Vector

v1 = Vector(1, 0, 0)
v2 = Vector.from_start_end([1, 0, 0], [2, 0, 0])
print("Are the two vectors equal?", v1 == v2)

f1 = Frame([0, 0, 0], [3, 0, 0], [0, 2, 0])
f2 = Frame.from_points([0, 0, 0], [5, 0, 0], [1, 2, 0])
print("Are the two frames equal?", f1 == f2)
# ---------- end construct ----------

transform = Python3Script()  # -> p1, p2
# ---------- transform: Python ----------
# r: compas
# venv: ca-hs25

from compas.geometry import Point
from compas.geometry import Translation

p1 = Point(1, 0, 0)

# translate
t = Translation.from_vector([5, 1, 0])
p2 = p1.transformed(t)
# ---------- end transform ----------

shapes = Python3Script()  # -> out, b1, s1, c1
# ---------- shapes: Python ----------
# r: compas
# venv: ca-hs25

from compas.geometry import Box
from compas.geometry import Circle
from compas.geometry import Cylinder
from compas.geometry import Frame
from compas.geometry import Plane
from compas.geometry import Sphere

# Box
frame_box = Frame.worldXY()
b1 = Box(5, 1, 3, frame_box)          # xsize, ysize, zsize
b2 = Box.from_width_height_depth(5, 3, 1)   # width=xsize, height=zsize, depth=ysize
print(b1)

# Sphere
frame_sphere = Frame([20,0,0], [1,0,0], [0,1,0]) 
s1 = Sphere(5, frame_sphere)
print(s1)

# Cylinder
frame_cylinder = Frame([40,0,0], [1,0,0], [0,1,0]) 
c1 = Cylinder(5, 4, frame_cylinder)
print(c1)
# ---------- end shapes ----------

# ----
draw_4 = Python3Script(cg=transform.p1)  # -> rg; same code as draw
draw_5 = Python3Script(cg=transform.p2)  # -> rg; same code as draw

draw_6 = Python3Script(cg=shapes.b1)  # -> rg; same code as draw
draw_7 = Python3Script(cg=shapes.s1)  # -> rg; same code as draw
draw_8 = Python3Script(cg=shapes.c1)  # -> rg; same code as draw

draw_9 = Python3Script(cg=construct.v1)  # -> rg; same code as draw
draw_10 = Python3Script(cg=construct.v2)  # -> rg; same code as draw
draw_11 = Python3Script(cg=construct.f1)  # -> rg; same code as draw
draw_12 = Python3Script(cg=construct.f2)  # -> rg; same code as draw

draw_13 = Python3Script(cg=primitives.point)  # -> rg; same code as draw
draw_14 = Python3Script(cg=primitives.polyline)  # -> rg; same code as draw
draw_15 = Python3Script(cg=primitives.polygon)  # -> rg; same code as draw

# ---- group: GhPython Script
mesh = Python3Script()  # -> mesh
# ---------- mesh: Python ----------
# r: compas
# venv: ca-hs25

import compas
from compas.datastructures import Mesh

mesh = Mesh.from_obj(compas.get("hypar.obj"))
# ---------- end mesh ----------

graph = Python3Script()  # -> graph
# ---------- graph: Python ----------
# r: compas
# venv: ca-hs25

import compas
from compas.datastructures import Graph

graph = Graph.from_obj(compas.get("grid_irregular.obj"))

print(graph.summary())
# ---------- end graph ----------

volmesh = Python3Script()  # -> vm
# ---------- volmesh: Python ----------
# r: compas
# venv: ca-hs25

from compas.datastructures import VolMesh

vm = VolMesh.from_meshgrid()
# ---------- end volmesh ----------

volmesh_2 = Python3Script()  # -> vm; same code as volmesh

# ----
cells = Python3Script(vm=volmesh_2, i=Slider(0, range=0..999))  # -> cell, n
# ---------- cells: Python ----------
# r: compas
# venv: ca-hs25

print(f"Found {vm.number_of_cells()} cells")

cell = vm.cell_to_mesh(i)
n = []

for nbr in vm.cell_neighbors(i):
    n.append(vm.cell_to_mesh(nbr))
# ---------- end cells ----------
draw_16 = Python3Script(cg=cells.n)  # -> rg; same code as draw
draw_17 = Python3Script(cg=cells.cell)  # -> rg; same code as draw

draw_18 = Python3Script(cg=graph)  # -> rg; same code as draw

draw_19 = Python3Script(cg=mesh)  # -> rg
#   port cg: The COMPAS geometry or datastructure to be drawn.
#   port rg: The Rhino geometry object.
# ---------- draw_19: Python ----------
# r: compas
# venv: ca-hs25

"""
Draws COMPAS geometry in Grasshopper.
"""

from ghpythonlib.componentbase import executingcomponent as component

from compas.scene import Scene


class CompasToRhinoGeometry(component):
    def RunScript(self, cg):
        if not cg:
            return None

        scene = Scene()
        scene.add(cg)

        return scene.draw()
# ---------- end draw_19 ----------

draw_20 = Python3Script(cg=volmesh)  # -> rg; same code as draw
